# Grasshopper definition Root_Frames_&_Bridges.gh (Grasshopper 1.0.8)
# plug-ins: Telepathy

# ---- group: _REF_LIBRARY
number_slider = Slider(9, range=0..90)  # disabled
choose_axis = Panel("X")  # disabled
number_slider_2 = Slider(12, range=-20..600)  # disabled
number_slider_3 = Slider(10, range=0..10)  # disabled
number_slider_4 = Slider(3, range=0..10)  # disabled
number_slider_5 = Slider(1, range=0..30)  # disabled
xy = XYPlane(Origin=Point(0, 0, 0))  # disabled
crv = Curve(<curve referenced from the Rhino model>)  # disabled
py3 = Python3Script(
    curve=crv,
    num_sides=number_slider_4,
    radius=number_slider_3,
    total_height=number_slider_2,
    h_subdivisions=number_slider_5)  # -> out, column_mesh, list_points, center_points, column_mesh_rhino; inputs curve: Polyline, num_sides: Int32, radius: Int32, total_height: Int32, h_subdivisions: Int32; disabled
# ---------- py3: Python ----------
import mola
from mola import module_rhino
import math
import Rhino.Geometry as rg

def points_on_crv(curve):
    list_of_points = []
    for p in curve:
        pt = rg.Point3d(p)
        list_of_points.append(pt)
    return list_of_points

def points_on_polygon(num_sides, radius):   
    list_of_points = []
    theta = (2*math.pi)/num_sides
    for i in range(num_sides):
        angle = i * theta
        x = radius * math.cos(angle)
        y = radius * math.sin(angle)
        z = 0
        pt = rg.Point3d(x,y,z)
        list_of_points.append(pt)
    return list_of_points


if curve is not None:
    list_points = points_on_crv(curve)

else:
    list_points = points_on_polygon(num_sides, radius)



column_mesh = mola.Mesh()

new_pts = []

for layer_no in range (h_subdivisions +1):
    y = total_height/h_subdivisions * layer_no + float(114.5)
    for p in list_points:
        pt = rg.Point3d(p)
        pt[1] = y
        new_pts.append (pt)
        column_mesh.add_vertex(pt[0],pt[1], pt[2])

points_per_layer = len(list_points)

for layer_no in range (h_subdivisions):
    current_layer = layer_no * points_per_layer
    next_layer = (layer_no + 1) * points_per_layer
    for i in range (points_per_layer-1):
        next_i = (i+1) % points_per_layer

        v0 = column_mesh.vertices[current_layer + i]
        v1 = column_mesh.vertices[current_layer + next_i]
        v2 = column_mesh.vertices[next_layer + next_i]
        v3 = column_mesh.vertices[next_layer + i]

        column_mesh.add_face([v0,v1,v2,v3])

center_points = []
for f in (column_mesh.faces):
    c = f.center()
    
    pts = rg.Point3d(c.x, c.y, c.z)
    center_points.append(pts)

column_mesh.update_topology()
column_mesh_rhino = module_rhino.display_mesh(column_mesh)
# ---------- end py3 ----------
geo = Geometry(py3.column_mesh_rhino)  # disabled
geo_2 = Geometry(py3.list_points)  # disabled

# ----
toggle_mode = ValueList({"branch", "bridge"}, selected="branch")

# ---- group: Surface_to_Brep_for_Random_Points
height_subdiv = Slider(14, range=0..30)
layer_height = Slider(0, range=0..30)
randomness = Slider(1, range=0..1)
twist_angle = Slider(0, range=0..90)
point_density = Slider(100, range=0..100)
max_height = Slider(1000, range=0..1000)
srf = Surface(<surface referenced from the Rhino model>)
crv_2 = Curve(<curve referenced from the Rhino model>)
brep_for_random_points = Python3Script(
    srf_input=srf,
    curve_input=crv_2,
    height_subdiv=height_subdiv,
    point_density=point_density,
    max_height=max_height,
    layer_height=layer_height,
    randomness=randomness,
    twist_angle=twist_angle)  # -> out, list_pts, srf_out; inputs srf_input: Surface, curve_input: Curve, height_subdiv: Int32, point_density: Int32, max_height: Int32, layer_height: Int32, randomness: Double
# ---------- brep_for_random_points: Python ----------
import Rhino.Geometry as rg
import random, math


# - If a curve is provided -> extrusion + layer logic
# - If a surface/Brep is provided -> UV sampling (Z-height ignored)

#rotate a point around centroid by ang_rad

def rotate_point_z(pt, cx, cy, ang_rad):
    dx = pt.X - cx
    dy = pt.Y - cy
    ca = math.cos(ang_rad)
    sa = math.sin(ang_rad)
    x = cx + dx * ca - dy * sa
    y = cy + dx * sa + dy * ca
    return rg.Point3d(x, y, pt.Z)

# CURVE INPUT

if curve_input is not None and srf_input is None:
    
    # 1. Create vertical extrusion surface
    z_dir = rg.Vector3d(0,0,1)
    surface = rg.Surface.CreateExtrusion(curve_input, z_dir * max_height)
    
    if not surface:
        raise Exception("Failed to extrude curve_input.")

    brep = surface.ToBrep()
    face = brep.Faces[0]

    # Output surface
    srf_out = brep

    # UV sampling domain
    u_domain = face.Domain(0)
    v_domain = face.Domain(1)

    # Generate points layer-by-layer
    pts_all = []

    for layer in range(height_subdiv + 1):

        z = (max_height / float(height_subdiv)) * layer
        ang_rad = math.radians(twist_angle * layer)
        n = max(1, int(point_density))

        # Random UV sampling
        pts_layer = []
        for i in range(n):
            u = random.uniform(u_domain.T0, u_domain.T1)
            v = random.uniform(v_domain.T0, v_domain.T1)
            p = face.PointAt(u, v)

            pz = rg.Point3d(p.X, p.Y, z)
            pts_layer.append(pz)

        # Twist around centroid
        cx = sum(p.X for p in pts_layer) / len(pts_layer)
        cy = sum(p.Y for p in pts_layer) / len(pts_layer)
        pts_rot = [rotate_point_z(p, cx, cy, ang_rad) for p in pts_layer]

        # Sort angularly
        pts_sorted = sorted(
            pts_rot,
            key=lambda pt: math.atan2(pt.Y - cy, pt.X - cx)
        )

        pts_all.extend(pts_sorted)

    pts_out = pts_all



# IF SURFACE INPUT, UV-BASED LOGIC, HEIGHT IGNORED

elif srf_input is not None:

    # 1. Normalize input to a Brep and its first face
    if isinstance(srf_input, rg.Brep):
        brep = srf_input
    elif isinstance(srf_input, rg.Surface):
        brep = srf_input.ToBrep()
    elif isinstance(srf_input, rg.Extrusion):
        brep = srf_input.ToBrep()
    else:
        raise Exception("Unsupported srf_input type.")

    face = brep.Faces[0]
    srf_out = brep

    # 2. UV Sampling (Option 3 logic)
    u_dom = face.Domain(0)
    v_dom = face.Domain(1)

    num_points = int(point_density) * max(1, int(height_subdiv))

    pts = []
    for i in range(num_points):
        u = random.uniform(u_dom.T0, u_dom.T1)
        v = random.uniform(v_dom.T0, v_dom.T1)
        pts.append(face.PointAt(u, v))

    # 3. Sort bottom → top (Z-axis)
    pts_sorted = sorted(pts, key=lambda p: p.Z)

    # 4. Optional sequence inside each Z band: cluster points into height_subdiv groups

    clustered = []
    if height_subdiv > 0:
        zmin = min(p.Z for p in pts_sorted)
        zmax = max(p.Z for p in pts_sorted)
        zspan = zmax - zmin

        for k in range(height_subdiv + 1):
            z_lo = zmin + (zspan / height_subdiv) *  k
            z_hi = zmin + (zspan / height_subdiv) * (k+1)

            layer_pts = [p for p in pts_sorted if z_lo <= p.Z < z_hi]

            if len(layer_pts) > 2:
                cx = sum(p.X for p in layer_pts)/len(layer_pts)
                cy = sum(p.Y for p in layer_pts)/len(layer_pts)
                layer_pts = sorted(
                    layer_pts,
                    key=lambda p: math.atan2(p.Y - cy, p.X - cx)
                )

            clustered.extend(layer_pts)

        list_pts = clustered

    else:
        list_pts = pts_sorted
# ---------- end brep_for_random_points ----------
geo_3 = Geometry(brep_for_random_points.list_pts)
geo_4 = Geometry(brep_for_random_points.srf_out)

# ----
height_subdiv_2 = Slider(2, range=0..30)
twist_angle_2 = Slider(11, range=0..30)
max_height_2 = Slider(126, range=0..200)
layers = Slider(80, range=0..100)
rh_geometry = Geometry(<surface referenced from the Rhino model>)
crv_3 = Curve(<curve referenced from the Rhino model>)
bridged_branched_sticks = Python3Script(
    surface_or_curve=rh_geometry,
    height_subdiv=Slider(500, range=0..1000),
    point_density=Slider(100, range=0..100),
    twist_angle=Slider(90, range=0..100),
    rot_tan=Slider(90, range=0..100),
    rot_norm=Slider(90, range=0..100),
    mode=toggle_mode,
    face_index=Slider(4, range=0..4),
    stick_angle=Slider(90, range=0..135),
    offset0_1=Slider(1, range=0..1))  # -> out, geometries; inputs height_subdiv: Int32, point_density: Int32, twist_angle: Double, rot_tan: Double, rot_norm: Double, mode: String
# ---------- bridged_branched_sticks: Python ----------
import sys, os
import Rhino.Geometry as rg

# locate /scripts
path = ghenv.Component.OnPingDocument().FilePath
parent = os.path.dirname(path)
scripts = os.path.join(parent, "scripts")
if scripts not in sys.path:
    sys.path.append(scripts)

from RootFrames import RootFrames
from compas_rhino.conversions import box_to_rhino

# ----------------------------
# Construct engine
# ----------------------------
RF = RootFrames(
    surface=surface_or_curve if hasattr(surface_or_curve, "ToBrep") else None,
    curve=surface_or_curve if hasattr(surface_or_curve, "Domain") else None,
    height_subdiv=height_subdiv,
    point_density=point_density,
    twist_angle=twist_angle,
)

# ----------------------------
# Run full pipeline
# ----------------------------
sticks = RF.run(
    rot_tan=rot_tan,
    rot_norm=rot_norm,
    mode=mode,                # "branch" or "bridge"
    face_index=face_index,
    angle=stick_angle,
    offset01=offset0_1,
)

# ----------------------------
# Convert to Rhino geometry
# ----------------------------
geometries = []
for s in sticks:
    geometries.append(box_to_rhino(s.geometry))
# ---------- end bridged_branched_sticks ----------
brep_any_shape = Python3Script(curve_input=crv_3, pt_spacing=layers, max_height=max_height_2, height_subdiv=height_subdiv_2, twist_angle=twist_angle_2)  # -> out, list_pts; inputs curve_input: Curve, pt_spacing: Int32, max_height: Int32, height_subdiv: Int32, twist_angle: Double
# ---------- brep_any_shape: Python ----------
import Rhino.Geometry as rg
import math



list_pts = []

# define points on curve
L = curve_input.GetLength()
t_params = curve_input.DivideByLength(float(pt_spacing), True)
div_pts  = [curve_input.PointAt(t) for t in t_params] 

# curve centroid
cx = sum(p.X for p in div_pts) / len(div_pts)
cy = sum(p.Y for p in div_pts) / len(div_pts)
center = rg.Point3d(cx, cy, 0.0)

# rotation by curve centroid
def rot_at_Z (pt, ang_rad, c):
    ca = math.cos(ang_rad)
    sa = math.sin(ang_rad)
    dx = pt.X - c.X
    dy = pt.Y - c.Y
    x = c.X + (dx*ca - dy*sa)
    y = c.Y + (dx*sa + dy*ca)
    return x, y

# extrude layers in the z-direction
for each_layer in range (height_subdiv +1):
    z = max_height/height_subdiv * each_layer 
    ang_rad = math.radians(twist_angle * each_layer)

    if each_layer % 2 == 0:
        for p in div_pts:
            x, y = rot_at_Z(p, ang_rad, center)
            list_pts.append (rg.Point3d(x, y, z))
    
    else:
        
        for j in range(len(div_pts)):

            mid_pt_x = (div_pts[j]+ div_pts[(j + 1) % len(div_pts)]).X * 0.5
            mid_pt_y = (div_pts[j]+ div_pts[(j + 1) % len(div_pts)]).Y * 0.5

            x, y = rot_at_Z(rg.Point3d(mid_pt_x,mid_pt_y, 0.0), ang_rad, center)
            list_pts.append(rg.Point3d(x, y, z))
# ---------- end brep_any_shape ----------
list_pts = RemoteSender(brep_any_shape.list_pts)

# ---- group: Curve_to_Brep_for_Random_Points
twist_angle_3 = Slider(0, range=0..90)
layer_height_2 = Slider(7, range=0..30)
randomness_2 = Slider(0.6, range=0..1)
height_subdiv_3 = Slider(6, range=0..30)
point_density_2 = Slider(11, range=0..30)
max_height_3 = Slider(78, range=0..1000)
crv_4 = Curve(<curve referenced from the Rhino model>)
brep_for_random_points_2 = Python3Script(
    curve_input=crv_4,
    height_subdiv=height_subdiv_3,
    point_density=point_density_2,
    max_height=max_height_3,
    layer_height=layer_height_2,
    randomness=randomness_2,
    twist_angle=twist_angle_3)  # -> out, list_pts, srf_out; inputs curve_input: Curve, height_subdiv: Int32, point_density: Int32, max_height: Int32, layer_height: Int32, randomness: Double; disabled
# ---------- brep_for_random_points_2: Python ----------
import Rhino.Geometry as rg
import random, math


z_dir = rg.Vector3d(0,0,1)
surface = rg.Surface.CreateExtrusion(curve_input, z_dir * max_height)
brep = surface.ToBrep()
face = brep.Faces[0]

# UV domains for random sampling
u_domain = face.Domain(0)
v_domain = face.Domain(1)


# Output surface for GH preview
srf_out = brep



# Rotate pts around centroid by ang_rad

def rotate_point_z(pt, cx, cy, ang_rad):
    dx = pt.X - cx
    dy = pt.Y - cy
    ca = math.cos(ang_rad)
    sa = math.sin(ang_rad)
    x = cx + dx * ca - dy * sa
    y = cy + dx * sa + dy * ca
    return rg.Point3d(x, y, pt.Z)


# Generate list points by layer

list_pts = []

for layer in range(height_subdiv + 1):

    # Height of this layer
    z = (max_height / float(height_subdiv)) * layer

    # Twist angle for this layer
    ang_rad = math.radians(twist_angle * layer)

    # Number of points in this layer
    n = max(1, int(point_density))

    # Random sample points on the surface
    
    pts_layer = []
    for i in range(n):
        u = random.uniform(u_domain.T0, u_domain.T1)
        v = random.uniform(v_domain.T0, v_domain.T1)

        # define points on surface
        p = face.PointAt(u, v)

        # orient pt per Z-dir 
        p_layer = rg.Point3d(p.X, p.Y, z)
        pts_layer.append(p_layer)

    #Twist points around layer centroid
    
    cx = sum(p.X for p in pts_layer) / len(pts_layer)
    cy = sum(p.Y for p in pts_layer) / len(pts_layer)

    pts_rotated = [rotate_point_z(p, cx, cy, ang_rad) for p in pts_layer]

    # Sort points radially within the layer to sequence correctly

    pts_sorted = sorted(
        pts_rotated,
        key=lambda p: math.atan2(p.Y - cy, p.X - cx)
    )

    # Append them to the list of points
    list_pts.extend(pts_sorted)
# ---------- end brep_for_random_points_2 ----------
list_pts_2 = RemoteReceiver([brep_for_random_points_2.list_pts, list_pts])
geo_5 = Geometry(brep_for_random_points_2.srf_out)  # disabled
geo_6 = Geometry(list_pts_2)  # disabled

# ----
geo_7 = Geometry(bridged_branched_sticks.geometries)
geo_8 = Geometry(list_pts)
rot_at_tan = Slider(0, range=-90..0)

# ---- group: Create Planes_and_their_Rotations
rot_at_tan_2 = Slider(-90, range=-90..0)
planes_that_rotate = Python3Script(list_pts=brep_for_random_points.list_pts, rot_at_tan=rot_at_tan_2, rot_at_norm=rot_at_tan)  # -> out, way_planes; inputs list_pts: list of Point3d, rot_at_tan: Double
# ---------- planes_that_rotate: Python ----------
import Rhino.Geometry as rg
import math

#define a vector by the rel. coordinates of two consecutive points
def vec(a, b):
    return rg.Vector3d(b.X - a.X, b.Y - a.Y, b.Z - a.Z)

# set up
Z = rg.Vector3d(0, 0, 1)
way_planes = []
n = len(list_pts)

for i, pt in enumerate(list_pts):
    # estimate tangent
    if  i == 0:
        tan = vec(list_pts[0], list_pts[1])
    elif i == n - 1:
        tan = vec(list_pts[n - 2], list_pts[n - 1])
    else:
        tan = vec(list_pts[i - 1], list_pts[i + 1])

    # keep planes horizontal (about global Z)
    tan.Z = 0.0
    if not tan.Unitize():                     # guard zero-length & keeps tan to local pt coordinates
        tan = rg.Vector3d(1, 0, 0)

    norm = rg.Vector3d.CrossProduct(Z, tan)   
    if not norm.Unitize():                   # guard parallel cases
        norm = rg.Vector3d(0, 1, 0)

    # base plane
    pl = rg.Plane(pt, tan, norm)

    # rotation around tangent 
    ang_tan = math.radians(rot_at_tan)
    R_tan = rg.Transform.Rotation(ang_tan, tan, pt)
    pl.Transform(R_tan)

    # rotate the 'norm' as well, and use the updated plane
    norm_rot = rg.Vector3d(norm)
    norm_rot.Transform(R_tan)

    # then rotation around normal
    ang_norm = math.radians(rot_at_norm)
    R_norm = rg.Transform.Rotation(ang_norm, norm_rot, pt)
    pl.Transform(R_norm)

    way_planes.append(pl)
# ---------- end planes_that_rotate ----------
geo_9 = Geometry(planes_that_rotate.way_planes)

# ----
angle = Slider(90, range=0..90)  # disabled
offset = Slider(37.8, range=0..100)  # disabled
face_index = Slider(2, range=0..4)  # disabled
root_index = Slider(5, range=0..5)  # disabled

list_pts_3 = RemoteReceiver(list_pts)
points = PointList(Points=list_pts_3, Size=Slider(2, range=0..10))

remote_receiver = RemoteReceiver()
panel = Panel(remote_receiver)

way_planes = RemoteReceiver()  # disabled
py3_2 = Python3Script(way_planes=way_planes, root_index=root_index, face_index=face_index, angle=angle, offset=offset)  # -> out, geometries; inputs way_planes: list, face_index: Int32, angle: Double, offset: Double; disabled
# ---------- py3_2: Python ----------
# r: compas>=2.14.1
# venv: sticks

import sys
import os
import math

#get current file path
path = ghenv.Component.OnPingDocument().FilePath
print (path)
#get parent directory of the parent directory
parentdir = os.path.dirname(path)
print (parentdir)
#get src folder which contains classes
dire = os.path.join(parentdir,'scripts')
print (dire)

sys.path.append(dire)

from compas_rhino import unload_modules

unload_modules("Sticks")
unload_modules("stick_module")

import Sticks
from Sticks import Stick 
from stick_module import BranchingModule
from compas.geometry import Point, Line, Point, Vector, Frame, Rotation

stick_width = 1.0
stick_depth = 1.0

from compas_rhino.conversions import plane_to_compas_frame, frame_to_rhino_plane

# Convert way_planes input to compas
root_frames = []
for pl in way_planes:
    root_frames.append(plane_to_compas_frame(pl))


root_frames_out = []
preview_planes = []                                         # Rhino planes to preview

# Apply root_index orientation per frame 
for f in root_frames:
    f_oriented = reorient_frame_for_root(f, root_index)
    root_frames_out.append(f_oriented)
    preview_planes.append(frame_to_rhino_plane(f_oriented))  # Rhino planes to preview

# Initialize tree
trees = []
for f in root_frames:
    trees.append(BranchingModule(f, stick_length=200, width=stick_width, depth=stick_depth))

# Grow tree
for t in trees:
    t.grow_stick(face_index = face_index, angle = angle, offset = offset)
    t.grow_stick(face_index = face_index, angle = angle, offset = offset)
    t.grow_stick(face_index = face_index, angle = angle, offset = offset) 

# Visualize
geometries = []
for t in trees:
    geomet = t.visualize()          
    geometries.extend(t.visualize())
# ---------- end py3_2 ----------
draw = COMPASDraw(cg=py3_2.geometries)  # -> rg; disabled
#   port cg: The COMPAS geometry or datastructure to be drawn.
#   port rg: The Rhino geometry object.
# ---------- draw: Python ----------
# r: compas>=2.14.1
"""
Draws COMPAS geometry in Grasshopper.
"""

from typing import Any

import Grasshopper

from compas.scene import SceneObject


class CompasToRhinoGeometry(Grasshopper.Kernel.GH_ScriptInstance):
    def RunScript(self, cg):
        if not cg:
            return None

        return SceneObject(item=cg).draw()
# ---------- end draw ----------

# ---- group: ConvertPlanes_to_CompasFrames
root_offset_normal = Slider(0, range=0..20)
root_offset_planar = Slider(0, range=0..20)
root_index_2 = Slider(0, range=0..5)
convert_to_compasframes = Python3Script(
    way_planes=planes_that_rotate.way_planes,
    root_index=root_index_2,
    root_offset_planar=root_offset_planar,
    root_offset_normal=root_offset_normal)  # -> out, preview_planes, root_frames_out; inputs way_planes: list, root_offset_planar: Double
# ---------- convert_to_compasframes: Python ----------
# r: compas>=2.14.1
# venv: sticks

import sys
import os
import math

#get current file path
path = ghenv.Component.OnPingDocument().FilePath
print (path)
#get parent directory of the parent directory
parentdir = os.path.dirname(path)
print (parentdir)
#get src folder which contains classes
dire = os.path.join(parentdir,'scripts')
print (dire)

sys.path.append(dire)

from compas_rhino import unload_modules

unload_modules("Sticks2")
unload_modules("stick_module")

import Sticks2
from Sticks2 import Stick 
from stick_module import BranchingModule
from compas.geometry import Point, Line, Point, Vector, Frame, Rotation, Translation

stick_width = 1.0
stick_depth = 1.0

from compas_rhino.conversions import plane_to_compas_frame, frame_to_rhino_plane

# --- helper: rotate a frame so a chosen stick face is the "attach" face ---
def reorient_frame_for_root(f, index):
    """
    Assumes Stick local axes:
      X = stick length (forward), Y = width (left), Z = depth (up).
    By default, the 'bottom' face (−Z) lies on the root frame.
    Rotate the stick's local axes so another face becomes bottom:
      0: bottom  (−Z down)  -> no change
      1: top     (+Z down)  -> rotate 180° about X
      2: left    (−Y down)  -> rotate +90° about X
      3: right   (+Y down)  -> rotate −90° about X
      4: front   (+X down)  -> rotate +90° about Y
      5: back/   (−X down)  -> rotate −90° about Y
    """
    index = int(index) 
    if index == 0:
        return f
    if index  == 1:
        R = Rotation.from_axis_and_angle(f.xaxis, math.radians(180), point=f.point)
    elif index == 2:
        R = Rotation.from_axis_and_angle(f.xaxis, math.radians(+90), point=f.point)
    elif index == 3:
        R = Rotation.from_axis_and_angle(f.xaxis, math.radians(-90), point=f.point)
    elif index == 4:
        R = Rotation.from_axis_and_angle(f.yaxis, math.radians(+90), point=f.point)
    elif index == 5:
        R = Rotation.from_axis_and_angle(f.yaxis, math.radians(-90), point=f.point)
    else:
        # default = no change
        return f

    f2 = Frame(f.point, f.xaxis, f.yaxis)  # copied frame
    f2.transform(R)
    return f2


# Convert way_planes input to compas
root_frames = []
for pl in way_planes:
    root_frames.append(plane_to_compas_frame(pl))


root_frames_out = []
preview_planes = []                                         # Rhino planes to preview


for f in root_frames:
    
    # Apply root_index orientation per frame 
    f_oriented = reorient_frame_for_root(f, root_index)

    # Apply frame planar offset 
    if root_offset_planar != 0:
            planar_offset_vec = (
                f_oriented.xaxis.scaled(root_offset_planar) +
                f_oriented.yaxis.scaled(root_offset_planar)
            )
            T = Translation.from_vector(planar_offset_vec)
            f_oriented.transform(T)

    # Apply frame normal offset
    if root_offset_normal != 0:
        normal_vec = f_oriented.zaxis.scaled(root_offset_normal)
        Tn = Translation.from_vector(normal_vec)
        f_oriented.transform(Tn)

    # outputs
    root_frames_out.append(f_oriented)
    preview_planes.append(frame_to_rhino_plane(f_oriented))
# ---------- end convert_to_compasframes ----------
pln = Plane(convert_to_compasframes.preview_planes)

# ---- group: ConvertPlanes_to_EdgeFrames&Vectors
root_offset_normal_2 = Slider(0, range=0..1000)
root_offset_planar_2 = Slider(0, range=0..1000)
root_index_3 = Slider(0, range=0..5)
convert_to_compasframes_2 = Python3Script(
    way_planes=planes_that_rotate.way_planes,
    root_index=root_index_3,
    root_offset_planar=root_offset_planar_2,
    root_offset_normal=root_offset_normal_2)  # -> out, edge_lines, edge_frames, edge_vectors; inputs way_planes: list, root_offset_planar: Double
# ---------- convert_to_compasframes_2: Python ----------
# r: compas>=2.14.1

import sys, os, math
import Rhino.Geometry as rg

# ------------------------------------------------------------
# Load COMPAS + conversions
# ------------------------------------------------------------
path = ghenv.Component.OnPingDocument().FilePath
parentdir = os.path.dirname(path)
scripts_dir = os.path.join(parentdir, 'scripts')
sys.path.append(scripts_dir)

from compas.geometry import (
    Frame,
    Point,
    Vector,
    Line,
    Rotation,
    Translation,
)
from compas_rhino.conversions import plane_to_compas_frame


# ------------------------------------------------------------
# Helper: rotate a base frame (same as earlier)
# ------------------------------------------------------------
def reorient_frame_for_root(f, index):
    index = int(index)
    if index == 0:
        return f

    if index == 1:
        R = Rotation.from_axis_and_angle(f.xaxis, math.radians(180), point=f.point)
    elif index == 2:
        R = Rotation.from_axis_and_angle(f.xaxis, math.radians(90), point=f.point)
    elif index == 3:
        R = Rotation.from_axis_and_angle(f.xaxis, math.radians(-90), point=f.point)
    elif index == 4:
        R = Rotation.from_axis_and_angle(f.yaxis, math.radians(90), point=f.point)
    elif index == 5:
        R = Rotation.from_axis_and_angle(f.yaxis, math.radians(-90), point=f.point)
    else:
        return f

    f2 = Frame(f.point, f.xaxis, f.yaxis)
    f2.transform(R)
    return f2


# ------------------------------------------------------------
# Helper: planar + normal offsets
# ------------------------------------------------------------
def apply_offsets(f, planar, normal):
    if planar:
        move = f.xaxis.scaled(planar) + f.yaxis.scaled(planar)
        f.transform(Translation.from_vector(move))

    if normal:
        f.transform(Translation.from_vector(f.zaxis.scaled(normal)))

    return f


# ------------------------------------------------------------
# Helper: produce a stable orthonormal frame
#   with:
#       origin = p0
#       xaxis  = direction vector (unit)
# ------------------------------------------------------------
def orthonormal_frame_from_direction(origin, xaxis):
    """Return a stable Frame(origin, x, y) with guaranteed orthonormality."""

    x = xaxis.copy()
    x.unitize()

    # Choose any non-parallel "up" vector
    worldZ = Vector(0, 0, 1)
    worldY = Vector(0, 1, 0)
    up = worldZ if abs(x.dot(worldZ)) < 0.95 else worldY

    # Construct a stable z-axis
    z = x.cross(up)
    if z.length < 1e-6:      # rare fallback
        up = Vector(1, 0, 0)
        z = x.cross(up)
    z.unitize()

    # Construct y-axis
    y = z.cross(x)
    y.unitize()

    return Frame(origin, x, y)


# ------------------------------------------------------------
# 1) Convert GH planes to frames
# ------------------------------------------------------------
frame_list = []
for pl in way_planes:
    f = plane_to_compas_frame(pl)
    f = reorient_frame_for_root(f, root_index)
    f = apply_offsets(f, root_offset_planar, root_offset_normal)
    frame_list.append(f)

# Extract points
points = [f.point for f in frame_list]
N = len(points)


# ------------------------------------------------------------
# 2) Compute nearest-neighbor connections
# ------------------------------------------------------------
edges = set()

for i in range(N):
    p_i = points[i]
    best_j = None
    best_d = 1e9

    for j in range(N):
        if i == j:
            continue
        d = p_i.distance_to_point(points[j])
        if d < best_d:
            best_d = d
            best_j = j

    if best_j is not None:
        edges.add(tuple(sorted((i, best_j))))


# ------------------------------------------------------------
# 3) Build projected vectors + orthonormal frames
# ------------------------------------------------------------
edge_vectors = []
edge_frames  = []
edge_lines   = []

for i, j in edges:
    f0 = frame_list[i]
    p0 = points[i]
    p1 = points[j]

    # step 1 — compute raw direction
    v = Vector.from_start_end(p0, p1)

    # step 2 — project onto local tangent plane (remove normal component)
    v_proj = v - f0.zaxis.scaled(v.dot(f0.zaxis))
    if v_proj.length < 1e-6:
        v_proj = f0.xaxis.copy()
    v_proj.unitize()

    # Build stable orthonormal frame
    new_f = orthonormal_frame_from_direction(p0, v_proj)

    # Save outputs
    edge_vectors.append(v_proj)
    edge_frames.append(new_f)

    # preview line for GH
    A = rg.Point3d(p0.x, p0.y, p0.z)
    B = rg.Point3d(
        p0.x + v_proj.x * 50,
        p0.y + v_proj.y * 50,
        p0.z + v_proj.z * 50
    )
    edge_lines.append(rg.Line(A, B))


# ------------------------------------------------------------
# OUTPUTS
# ------------------------------------------------------------
# Provide these to downstream code
# ---------- end convert_to_compasframes_2 ----------
geo_10 = Geometry(convert_to_compasframes_2.edge_lines)

# ----
panel_2 = Panel(convert_to_compasframes_2.edge_frames)

# ---- group: Branching Sticks
growth_steps = Slider(1, range=0..4)
offset_2 = Slider(0.8, range=0..1)
face_index_2 = Slider(0, range=0..4)
angle_2 = Slider(79.4, range=0..90)
sticks_that_grow = Python3Script(
    edge_frames=convert_to_compasframes_2.edge_frames,
    edge_vectors=convert_to_compasframes_2.edge_vectors,
    NUM_GROWTH_STEPS=growth_steps,
    face_index=face_index_2,
    angle=angle_2,
    offset=offset_2)  # -> out, geometries; inputs edge_frames: list, edge_vectors: list, NUM_GROWTH_STEPS: Int32, face_index: Int32, angle: Double, offset: Double
# ---------- sticks_that_grow: Python ----------
# r: compas>=2.14.1
# venv: sticks

import sys, os
import Rhino.Geometry as rg

from compas_rhino import unload_modules
from compas_rhino.conversions import box_to_rhino
from compas.geometry import Line


# ------------------------------------------------------------
# Load your custom scripts
# ------------------------------------------------------------
path = ghenv.Component.OnPingDocument().FilePath
parentdir = os.path.dirname(path)
scripts_dir = os.path.join(parentdir, 'scripts')
sys.path.append(scripts_dir)

unload_modules("Sticks2")
unload_modules("stick_module")

from Sticks2 import Stick
from stick_module import BranchingModule


# ------------------------------------------------------------
# GH Inputs:
#
# edge_frames      : list of COMPAS Frames
# edge_vectors     : list of COMPAS Vectors (parallel)
# NUM_GROWTH_STEPS : int
# face_index       : int 0–3
# angle            : float (deg)
# ------------------------------------------------------------


# ------------------------------------------------------------
# Validate inputs
# ------------------------------------------------------------
if not edge_frames:
    raise Exception("edge_frames input is empty.")

if not edge_vectors:
    raise Exception("edge_vectors input is empty.")

if len(edge_frames) != len(edge_vectors):
    raise Exception("edge_frames and edge_vectors must have same length.")


# ------------------------------------------------------------
# Use Stick CLASS CONSTANTS
# ------------------------------------------------------------
STICK_LEN   = Stick.LENGTH
STICK_WIDTH = Stick.WIDTH
STICK_DEPTH = Stick.DEPTH


# ------------------------------------------------------------
# MAIN LOOP
# ------------------------------------------------------------
geometries = []
trees = []

for f, v in zip(edge_frames, edge_vectors):

    # ------------------------------------------------------------------
    # 1. Construct axis aligned with GH vector
    # ------------------------------------------------------------------
    origin = f.point
    endpt = origin + v.scaled(STICK_LEN)

    axis = Line(origin, endpt)

    # ------------------------------------------------------------------
    # 2. Create the root stick (main stick)
    # ------------------------------------------------------------------
    root_stick = Stick(
        axis=axis,
        length=STICK_LEN,
        width=STICK_WIDTH,
        depth=STICK_DEPTH
    )

    # Output main stick geometry
    geometries.append(box_to_rhino(root_stick.geometry))


    # ------------------------------------------------------------------
    # 3. Build branching tree starting from THIS root stick
    # ------------------------------------------------------------------
    tree = BranchingModule(
        root_stick=root_stick,
        stick_length=STICK_LEN,
        width=STICK_WIDTH,
        depth=STICK_DEPTH
    )

    # Grow branch
    for _ in range(NUM_GROWTH_STEPS):
        tree.grow_stick(
            from_stick_index=-1,
            face_index=face_index,
            angle=angle,
            offset=offset
        )


    # Output branch geometry
    for s in tree.sticks:
        geometries.append(box_to_rhino(s.geometry))

    trees.append(tree)


# Visualize
geometries = []
for t in trees:
    geomet = t.visualize()          
    geometries.extend(t.visualize())
# ---------- end sticks_that_grow ----------
compas_draw = COMPASDraw(cg=sticks_that_grow.geometries)  # -> rg; same code as draw
